# Grasshopper definition 00_UR_basicSettings.ghx (Grasshopper 1.0.7)

reset_parameters = Button()

# ----
# Fabrication Parameters
vel_in_mm_s = Slider(60, range=0..100)
accel = Slider(0.05, range=0..0.1)
division = Division(A=vel_in_mm_s, B="1000")

# ----
# Slice List
max_drop_counts = Panel("299")
slice_length = Slider(250, range=0..500)

panel = Panel(division)
python = GhPythonScript(vel=division, accel=accel, max_drops=max_drop_counts, slice_length=slice_length, reset=reset_parameters)  # -> visualization, way_plane_nlist, vel_nlist, accel_nlist; inputs way_plane_nlist: list, max_drops: Int32, slice_length: Int32, reset: Boolean
# ---------- python: Python ----------
import Rhino.Geometry as rg
import ghpythonlib.components as ghc
import ghpythonlib.treehelpers as th
from compas_ghpython import ghtree_to_list, list_to_ghtree 
from scriptcontext import sticky as drop_params

from compas_rhino import unload_modules
unload_modules('data_structure')
import data_structure as ds

if reset:
    drop_params.clear()
else:
    drop_params['planes'] = way_plane_nlist
    drop_params['velocities'] = ds.duplicate_data(way_plane_nlist, vel)
    drop_params['accelerations'] = ds.duplicate_data(way_plane_nlist, accel)
    drop_params['constant_velocity'] = vel
    drop_params['constant_acceleration'] = accel
    drop_params['ed_x'] = ed_x
    drop_params['ed_y'] = ed_y
    drop_params['ed_z'] = ed_z


all_planes = ds.flatten_nlist(drop_params['planes'])

if len(all_planes) <= max_drops:
    for key, items in drop_params.items():
        way_plane_nlist     = drop_params['planes']
        vel_nlist           = drop_params['velocities'] 
        accel_nlist         = drop_params['accelerations']
else:
    for key, items in drop_params.items():
        if key == 'planes':
            way_plane_nlist = ds.rearrange_nlist(items, slice_length)
        elif key == 'velocities':
            vel_nlist = ds.rearrange_nlist(items, slice_length)
        elif key == 'accelerations':
            accel_nlist = ds.rearrange_nlist(items, slice_length)
        elif key == 'waits':


"""
Check whether all data lengths are equal
"""

for i in range(len(way_plane_nlist)):
    if len(way_plane_nlist[i]) == len(vel_nlist[i]) == len(accel_nlist[i]) == len(wait_nlist[i]) == len(drop_distance_nlist[i]):
        print ('ok', 'length : ', len(way_plane_nlist[i]))
    else:
        print ('data len doesnt match :', i)

"""Visualization in GH"""
visualization = list_to_ghtree (way_plane_nlist)
# ---------- end python ----------

# ----
# Fabricating :)
send_pre_dropping = Button()
send_dropping = Button()
predrop_count = Slider(8, range=0..100)

# ----
# Modify it when data needs to be sliced
l_index = Slider(0, range=0..100)

# ----
# Generate script
dropping = GhPythonScript(l_index=l_index, preDrop_count=predrop_count)  # -> script_D; inputs way_plane_nlist: list, vel_nlist: list, accel_nlist: list, drop_distance_nlist: list, l_index: Int32, preDrop_count: Int32
# ---------- dropping: Python ----------
import ghpythonlib.components as ghc
import ghpythonlib.treehelpers as th
from compas_ghpython import ghtree_to_list, list_to_ghtree 
import Rhino.Geometry as rg
import math as m

from compas_rhino import unload_modules
unload_modules('simple_ur_script')
unload_modules('simple_comm')
unload_modules('sticky')
import simple_comm as c
import simple_ur_script as ur
from scriptcontext import sticky as drop_params

velocity = drop_params['constant_velocity']
acceleration = drop_params['constant_acceleration']
ed_x = drop_params['ed_x']
ed_y = drop_params['ed_y']
ed_z = drop_params['ed_z']


script = ""
script += ur.textmsg("Current plane index: ",l_index )
script += ur.set_tcp_by_angles(ed_x*-1, ed_z + drop_dis, ed_y, m.radians(91.0), m.radians(0.0), m.radians(0.0))
script += ur.set_digital_out(2, True)#Activate Fan

#   Move to pre drop location
script += ur.move_j([m.radians(109.10),m.radians(-209.66),m.radians(-74.08),m.radians(-75.23),m.radians(-70.9),m.radians(-180)], acceleration, velocity)

for i, (wp_list, vel_list, accel_list) in enumerate(zip(way_plane_nlist, material_nlist, vel_nlist, accel_nlist)):
    for j,(wp, material, vel, accel) in enumerate(zip(wp_list, vel_list, accel_list)):
        script += "    "+ ur.move_l(wp, accel, vel)

script_D = c.concatenate_script("def drop():",script)
# ---------- end dropping ----------

# ----
# Send to UR
send_to_ur = GhPythonScript(script_D=dropping, send_dropping=send_dropping)  # inputs send_dropping: Boolean
# ---------- send_to_ur: Python ----------
from compas_rhino import unload_modules
unload_modules('simple_comm')
import simple_comm as c


if send_dropping:
    c.send_script(script_D, "192.168.10.10")
# ---------- end send_to_ur ----------

# ---- group: Ori Pt
# Calibration
# UR10 Calibration Points & Work Area
# 
# Tool tip should just touch the ruler!!!
# 
# You should feel it's hardly to move the ruler
panel_2 = Panel("515.00")
panel_3 = Panel("-268.5")
pt = ConstructPoint(XCoordinate=panel_2, YCoordinate="-180.00", ZCoordinate=panel_3)

# ---- group: xAxis_pt
panel_4 = Panel("-270")
pt_2 = ConstructPoint(XCoordinate="765.00", YCoordinate="-180.00", ZCoordinate=panel_3)

# ---- group: yAxis_pt
panel_5 = Panel("-270.00")
pt_3 = ConstructPoint(XCoordinate="515.00", YCoordinate="210.00", ZCoordinate=panel_3)

# ---- group: Safe_pt
pt_4 = ConstructPoint(XCoordinate="515.00", YCoordinate="-180.00", ZCoordinate="-54")

# ----
# Slicing Parameters
layer_height = Slider(3, range=0.5..10)
layer_thickness = Slider(2, range=1..10)
seg_length = Slider(2.9, range=0.1..10)
offset_distance = Slider(6, range=0.5..50)

# ----
# Robot Parameters
velocity = Slider(15, range=0..50)
acceleration = Slider(5, range=0..50)

# ----
# Input Geo
brep = Brep(<brep referenced from the Rhino model>)

brep_2 = Brep(<brep referenced from the Rhino model>)
panel_6 = Panel("20")

# ----
# Robot safety position
# End-effector installation position
robot_joint_angles = Panel("""-180.00
-55.00
125.00
-260.00
-90.00
180.00""")

# ---- group: Select Target Pt
list = ValueList({"Origin Point": 0, "X Axis Point": 1, "Y Axis Point": 2, "Safe Point": 3}, selected="Origin Point")
filter = StreamFilter(Gate=list, Stream0=pt, Stream1=pt_2, Stream2=pt_3, Stream3=pt_4)

# ----
# Slicing + Support
contour = GhPythonScript(brep=brep_2, layer_height=brep, offset_distance=offset_distance, layer_thickness=layer_thickness)  # -> xxx, zzzz, vis_contourCrvs, contourCrv_nList; inputs brep: Brep, layer_thickness: Int32
# ---------- contour: Python ----------
__author__ = "Fen"
import Rhino.Geometry as rg
import ghpythonlib.components as ghc
import ghpythonlib.treehelpers as th
from compas_ghpython import ghtree_to_list, list_to_ghtree 
"-------Import Library-------"
from compas_rhino import unload_modules
unload_modules('e2e_pathSlicer')
import e2e_pathSlicer as ps
"-------------------------------------"

def contour_XY(brep, layer_height, simplify):
    contour_crvs =[]
    bbox = rg.Brep.GetBoundingBox(brep, rg.Plane.WorldXY)
    lowest_pt = bbox.Min
    highest_pt = bbox.Max
    #print (bbox.Min)
    #print (bbox.Max)
    contour_range = int((highest_pt.Z-lowest_pt.Z)/layer_height) +1
    normal =  rg.Vector3d(0,0,1)
    #planes=[]

    for i in range(contour_range):
        plane_ori = lowest_pt + normal*layer_height*i
        intersection_plane = rg.Plane(plane_ori, rg.Vector3d.XAxis, rg.Vector3d.YAxis)
        #planes.append(intersection_plane)
        intersection_events = rg.Intersect.Intersection.BrepPlane(brep, intersection_plane,0.01)
        if intersection_events[0]:
            layer_crvs = intersection_events[1]
            if len(layer_crvs)>1:
                layer_crvs = rg.Curve.JoinCurves(layer_crvs)
            for crv in layer_crvs:
                if simplify:
                    crv.Simplify(rg.CurveSimplifyOptions.All, distanceTolerance=0.01, angleToleranceRadians=0.01)
                contour_crvs.append(crv)
    return contour_crvs

# get contour curves from a brep
vis_contourCrvs = ps.contour_XY(brep, layer_height, True)
contourCrv_nList =[]

bbcs=[]

#print (contourCrvs)

#if layer_thickness==1:
#    contourCrv_nList = [[crv] for crv in contourCrvs]
#elif layer_thickness !=1:
#    for i,crv in enumerate(contourCrvs):
#        crvs = []
#        for j in range(layer_thickness):
#            if j ==0:
#                crvs.append(crv)
#            else:
#                bb = crv.GetBoundingBox(rg.Vector3d(0,0,1))
#                #to check curve center
#                bbcs.append(bb.Center)
#                offset_crv = rg.Curve.Offset(crv,bb.Center, rg.Vector3d(0,0,1),layer_thickness*j, 0.1,1,True,rg.CurveOffsetCornerStyle.None,rg.CurveOffsetEndStyle.Round)[0]
#                crvs.append(offset_crv)
#        contourCrv_nList.append(crvs)
#
#vis_contourCrvs = list_to_ghtree(contourCrv_nList)
# ---------- end contour ----------
crv = Curve(contour.vis_contourCrvs)

# ---- group: Send to calibrate table
# Here we calibrate the printing table
# 1.
# "Click send_TCP"
# 2.
# Set "tcp_h" to "0" while calibrating
# Set "tcp_h" >20  after calibration for safety reason
# 3. Click "send"
send_tcp = Button()
send = Button()
conplane = GhPythonScript()  # -> plane; inputs pt: Point3d
# ---------- conplane: Python ----------
import Rhino.Geometry as rg

plane = rg.Plane(pt, rg.Vector3d.XAxis, rg.Vector3d.YAxis)
# ---------- end conplane ----------
tcp_h = Slider(30.04, range=0..300)
# Robot Parameters
sendtopoint = GhPythonScript(target_plane=conplane, tcp_height=tcp_h, send_TCP=send_tcp, send=send)  # -> rhino_base_way_planes, robot_planes, target_plane, script; inputs target_plane: Plane, send_TCP: Boolean
# ---------- sendtopoint: Python ----------
from compas_rhino import unload_modules
unload_modules('simple_ur_script')
unload_modules('simple_comm')

import simple_comm as c
import simple_ur_script as ur
import Rhino.Geometry as rg
import math as m

if send_TCP:
    script = ""
    script += ur.set_tcp_by_angles(float(-17.90), float(45.85), float(143.68), m.radians(0.0), m.radians(180.0), m.radians(90.0))
    script = c.concatenate_script(script)
    c.send_script(script,"192.168.10.10")

T = rg.Transform.Translation(0,0,tcp_height)
target_plane.Transform(T)

if send:
    script = ""
    script += ur.set_tcp_by_angles(float(-17.90), float(45.85), float(143.68), m.radians(0.0), m.radians(180.0), m.radians(90.0))
    velocity = 0.05
    acceleration = 0.02
    
    script += ur.move_l(target_plane, acceleration, velocity)
    script = c.concatenate_script(script)
    c.send_script(script,"192.168.10.10")
# ---------- end sendtopoint ----------

# ----
panel_7 = Panel(contour.xxx)
# Modify Geometry
# Note
# motor 2600, UR 10mm/s
# good quality
dividecrvs = GhPythonScript(contourCrv_nList=contour.contourCrv_nList, seg_length=seg_length)  # -> vis_wayPoints, wayPoint_nList; inputs contourCrv_nList: list
# ---------- dividecrvs: Python ----------
__author__ = "Fen"
import Rhino.Geometry as rg
import ghpythonlib.components as ghc
import ghpythonlib.treehelpers as th
from compas_ghpython import ghtree_to_list, list_to_ghtree 
from scriptcontext import sticky
"-------Import Personal Library-------"
from compas_rhino import unload_modules
unload_modules('e2e_pathSlicer')
import e2e_pathSlicer as ps
"-------------------------------------"

"""
check if there's only a single path on each layer, 
if not, reverse every second layer
"""
check = [crv for list in contourCrv_nList for crv in list]
if len(contourCrv_nList) == len(check):
    pass
else:
    for i,layer in enumerate(contourCrv_nList):
        if i%2==1:
            layer.reverse()

"""
creat robot waypoints
"""
wayPoint_nList=[]
for crvs in contourCrv_nList:
    wayPoints = []
    for crv in crvs:
        if crv.Degree ==1:
            crv_segs = crv.DuplicateSegments()
            for i,seg in enumerate(crv_segs):
                if i !=len(crv_segs)-1:
                    wayPoints.append(seg.PointAtStart)
                else:
                    wayPoints.append(seg.PointAtStart)
                    wayPoints.append(seg.PointAtEnd)
        elif crv.Degree !=1:
            print "curved"
            pts,_ = ps.divide_crv(crv, seg_length, True)
            wayPoints.extend(pts)
    wayPoint_nList.append(wayPoints)



print len(wayPoint_nList)

vis_wayPoints = list_to_ghtree(wayPoint_nList)
# ---------- end dividecrvs ----------
pl = GhPythonScript(pt=filter)  # -> plane; inputs pt: Point3d; same code as conplane

# ----
# Robot TCP Adjustment
tcp_h_2 = Slider(50, range=0..300)

# ----
# Set robot to installation position
# BEFOR or AFTER printing.
installationpos = Button()

# ----
# Move robot to a certain point
targetpt = Button()

send_to = GhPythonScript(joints=robot_joint_angles, target_plane=pl, tcp_height=tcp_h_2, installationPos=installationpos, send=targetpt)  # -> script; inputs joints: list, target_plane: Plane, installationPos: Boolean
# ---------- send_to: Python ----------
from compas_rhino import unload_modules
unload_modules('simple_ur_script')
unload_modules('simple_comm')
import simple_comm as c
import simple_ur_script as ur
import Rhino.Geometry as rg
import math as m


ed_x = 0
ed_y = 80.00
ed_z = 95.75

T = rg.Transform.Translation(0,0,tcp_height)
target_plane.Transform(T)

velocity = 0.015
acceleration = 0.05
blend_redious = 0.005

if installationPos:
    script = ""
    joints = [m.radians(joints[i]) for i in range(len(joints))]
    script += ur.move_j(joints, acceleration, velocity)
    script = c.concatenate_script("def sendToSafePos():",script)
    c.send_script(script,"192.168.10.10")

elif send:
    script = ""
    script += ur.set_standard_analog_out(0,0)
    script += ur.set_tcp_by_angles(ed_x, ed_y, ed_z, m.radians(-180.0), m.radians(0.0), m.radians(-90.0))
    script += ur.move_l(target_plane, acceleration, velocity)
    script = c.concatenate_script("def sendToPt():",script)
    c.send_script(script,"192.168.10.10")
# ---------- end send_to ----------
# velocity = 0.020
# acceleration = 0.05
# blend_redious = 0.01
# layers = 50
# layer_height = 3.5
# velocity = 0.015
# acceleration = 0.05
# blend_redious = 0.005
# layers = 50
# layer_height = 4.0
# velocity = 0.08
# acceleration = 0.05
# blend_redious = 0.005
# layers = 50
# layer_height = 3.0
# velocity = 0.012
# acceleration = 0.05
# blend_redious = 0.01
# layers = 50
# layer_height = 3.5
panel_8 = Panel(send_to)
# Fabrication Data
# Rhino pt >>>target pt
python_2 = GhPythonScript(
    ori_pt=pt,
    xAxis_pt=pt_2,
    yAxis_pt=pt_3,
    wayPoint_nList=dividecrvs.wayPoint_nList,
    velocity=velocity,
    acceleration=acceleration)  # -> vis, wayPlane_nList, vel_nList, accel_nList, blend_nList, extr_nList; inputs ori_pt: Point3d, xAxis_pt: Point3d, yAxis_pt: Point3d, wayPoint_nList: list
# ---------- python_2: Python ----------
__author__ = "Fen"
import Rhino.Geometry as rg
import ghpythonlib.components as ghc
import ghpythonlib.treehelpers as th
from compas_ghpython import ghtree_to_list, list_to_ghtree 
from scriptcontext import sticky
"-------Import Personal Library-------"
from compas_rhino import unload_modules
unload_modules('e2e_pathSlicer')
import e2e_pathSlicer as ps
import utils as ut
"-------------------------------------"

def set_robot_basePlane(ori_pt, xAxis_pt, yAxis_pt):
    """ This function constructs the robot base plane form 3 calibrated points.
    """
    robot_basePlane = rg.Plane(ori_pt, xAxis_pt - ori_pt, yAxis_pt - ori_pt)
    return robot_basePlane

def rhino_to_robot_space(rhino_plane, rhino_basePlane, robot_basePlane):
    """ this function translates planes from the rhino cordinate system to
        the robot cordinate system.
        It uses "inputBase_pt", which should use the bottom left corner point(from top view in Rhino)
        to construct a "rhino plane",
        and get a transform matrix from it to the "robot base plane"
    """
    robot_plane = rhino_plane.Clone()
    _matrix = rg.Transform.PlaneToPlane(rhino_basePlane, robot_basePlane)
    robot_plane.Transform(_matrix)
    return robot_plane


velocity = velocity/1000
acceleration = acceleration/1000
print velocity

"""Here we create robot way planes"""
rhino_basePlane = rg.Plane.WorldXY
robot_basePlane = rg.Plane(ori_pt, xAxis_pt - ori_pt, yAxis_pt - ori_pt)

wayPlane_nList = []
vis = []
for pts in wayPoint_nList:
    rhino_planes = [rg.Plane(pt, rg.Vector3d.ZAxis) for pt in pts]
    robot_planes = [rhino_to_robot_space(rhino_plane, rhino_basePlane, robot_basePlane) for rhino_plane in rhino_planes]
    wayPlane_nList.append(robot_planes)
    vis.extend(robot_planes)
    

"""Here we create other parameters for robot"""
vel_nList =[]
accel_nList =[]
blend_nList =[]
extr_nList =[]
for i,pts in enumerate(wayPoint_nList):
    vels = []
    accels = []
    #blends = ps.calc_blendRadius(pts, buffer=0.0001)
    blends = []
    extrs = []
    if i==0:
        for pt in pts:
            vels.append(10.5/1000)#15*0.7
            accels.append(acceleration)
            extrs.append(True)
            blends.append(0.001)
    else:
        for pt in pts:
            vels.append(12/1000)
            accels.append(acceleration)
            extrs.append(True)
            blends.append(0.001)
    vel_nList.append(vels)
    accel_nList.append(accels)
    blend_nList.append(blends)
    extr_nList.append(extrs)

#print len(vel_nList[1]),len(accel_nList[1]),len(blend_nList[1]),len(extr_nList[1])

"""
first layer = 10.5
other = 12
good quality



"""
# ---------- end python_2 ----------
io_on = BooleanToggle(False)

# ----
# Run test print
send_2 = Button()

# ----
# Simulation
number_slider = Slider(2.3, range=0.5..5)
pt_5 = Point(python_2.vis)
pline = PolyLine(Vertices=pt_5, Closed=False)
points = PointList(Points=pt_5, Size=number_slider)

# ----
# Send
test_print = GhPythonScript(
    target_plane=pl,
    wayPlane_nList=python_2.wayPlane_nList,
    vel_nList=python_2.vel_nList,
    accel_nList=python_2.accel_nList,
    blend_nList=python_2.blend_nList,
    extr_nList=python_2.extr_nList,
    IO_on=io_on,
    send=send_2)  # -> script; inputs target_plane: Plane, wayPlane_nList: list, vel_nList: list, accel_nList: list, blend_nList: list, extr_nList: list, send: Boolean
# ---------- test_print: Python ----------
from compas_rhino import unload_modules
unload_modules('simple_ur_script')
unload_modules('simple_comm')
import simple_comm as c
import simple_ur_script as ur
import Rhino.Geometry as rg
import math as m

ed_x = 0
ed_y = 80.00
ed_z = 95.75
tcp_height =0

T = rg.Transform.Translation(0,0,tcp_height)
#target_plane.Transform(T)


if send:
    script = ""
    script += ur.set_digital_out(0, False)#Turn off air
    script += ur.set_standard_analog_out(0,0)#Turn off motor
    
    script += ur.set_tcp_by_angles(ed_x, ed_y, ed_z, m.radians(-180.0), m.radians(0.0), m.radians(-90.0))
    
    #change this plane to a safe plane above the bed
    #script += ur.move_l(target_plane, acceleration, velocity)
    
    for planes,vels,accels,blends,extrs in zip(wayPlane_nList,vel_nList,accel_nList,blend_nList,extr_nList):
        for plane,vel,accel,blend,extr in zip(planes,vels,accels,blends,extrs):
            script += ur.move_l_blend(plane, accel, vel, blend)
            if extr:
                script += ur.set_digital_out(0, True)#Turn on air
                script += ur.set_standard_analog_out(0,0.3)#0.3 = 3.0 Voltage

    script += ur.set_digital_out(0, False)#Turn off air
    script += ur.set_standard_analog_out(0,0)#Turn off motor
    
    #change this plane to a safe plane above the bed
    #script += ur.move_l(target_plane, acceleration, velocity)
    
    script = c.concatenate_script("def testPrint():",script)
    c.send_script(script,"192.168.10.10")
# ---------- end test_print ----------
panel_9 = Panel(test_print)
